# Dynamo graph SurfaceDebug.dyn (Dynamo 2.10.0.3455)

code_block = CodeBlock()
# ---------- code_block.designscript (4 lines) ----------
Point.ByCoordinates(6.292,-3.297,-1.311);
Point.ByCoordinates(4.599,4.910,5.869);
Point.ByCoordinates(-8.032,-8.329,-0.556);
Point.ByCoordinates(-7.966,7.580,5.366);
# ----------------------------------------
list_create = List.Create(item0=code_block.out0, item1=code_block.out1, item2=code_block.out2, item3=code_block.out3)
code_block_2 = CodeBlock { [1,1,1,1]; }
code_block_3 = CodeBlock { [0,0,1,1]; }
code_block_4 = CodeBlock { 1; }
byControlPointsWeightsKnots = NurbsSurface.ByControlPointsWeightsKnots(controlVertices=list_create, weights=code_block_2, knotsU=code_block_3, knotsV=code_block_3, uDegree=code_block_4, vDegree=code_block_4)
code_block_5 = CodeBlock { 0.5; }
pointAtParameter = Surface.PointAtParameter(surface=byControlPointsWeightsKnots, u=code_block_5, v=code_block_5)
code_block_6 = CodeBlock { Point.ByCoordinates(0,0,0); Point.ByCoordinates(10,0,0); Point.ByCoordinates(20,0,0); Point.ByCoordinates(30,0,0); }
list_create_2 = List.Create(item0=code_block_6.out0, item1=code_block_6.out1, item2=code_block_6.out2, item3=code_block_6.out3)
code_block_7 = CodeBlock()
# ---------- code_block_7.designscript (4 lines) ----------
Point.ByCoordinates(0,-10,0);
Point.ByCoordinates(10,-10,10);
Point.ByCoordinates(20,-10,0);
Point.ByCoordinates(30,-10,0);
# ----------------------------------------
list_create_3 = List.Create(item0=code_block_7.out0, item1=code_block_7.out1, item2=code_block_7.out2, item3=code_block_7.out3)
code_block_8 = CodeBlock()
# ---------- code_block_8.designscript (4 lines) ----------
Point.ByCoordinates(0,-20,0);
Point.ByCoordinates(10,-20,0);
Point.ByCoordinates(20,-20,0);
Point.ByCoordinates(30,-20,0);
# ----------------------------------------
list_create_4 = List.Create(item0=code_block_8.out0, item1=code_block_8.out1, item2=code_block_8.out2, item3=code_block_8.out3)
code_block_9 = CodeBlock()
# ---------- code_block_9.designscript (4 lines) ----------
Point.ByCoordinates(0,-30,0);
Point.ByCoordinates(10,-30,0);
Point.ByCoordinates(20,-30,0);
Point.ByCoordinates(30,-30,0);
# ----------------------------------------
list_create_5 = List.Create(item0=code_block_9.out0, item1=code_block_9.out1, item2=code_block_9.out2, item3=code_block_9.out3)
list_create_6 = List.Create(item0=list_create_2, item1=list_create_3, item2=list_create_4, item3=list_create_5)
byControlPoints = NurbsSurface.ByControlPoints(controlVertices=list_create_6)
controlPoints = NurbsSurface.ControlPoints(nurbsSurface=byControlPoints)
code_block_10 = CodeBlock { 0; 1; }
V = DoubleSlider(0.7, range=0..1 step 0.001)
byIsoCurveOnSurface = Curve.ByIsoCurveOnSurface(baseSurface=byControlPoints, direction=code_block_10.out0, parameter=V)
U = DoubleSlider(0.2, range=0..1 step 0.001)
byIsoCurveOnSurface_2 = Curve.ByIsoCurveOnSurface(baseSurface=byControlPoints, direction=code_block_10.out1, parameter=U)
code_block_11 = CodeBlock { [0.5,0.2]; [0.5,0.7]; }
pointAtParameter_2 = Surface.PointAtParameter(surface=byControlPoints, u=code_block_11.out0, v=code_block_11.out1)
normalAtParameter = Surface.NormalAtParameter(surface=byControlPoints, u=code_block_11.out0, v=code_block_11.out1)
code_block_12 = CodeBlock { 5; }
byStartPointDirectionLength = Line.ByStartPointDirectionLength(startPoint=pointAtParameter_2, direction=normalAtParameter, length=code_block_12)
tangentAtVParameter = Surface.TangentAtVParameter(surface=byControlPoints, u=code_block_11.out0, v=code_block_11.out1)
watch = Watch(tangentAtVParameter)
tangentAtUParameter = Surface.TangentAtUParameter(surface=byControlPoints, u=code_block_11.out0, v=code_block_11.out1)
byStartPointDirectionLength_2 = Line.ByStartPointDirectionLength(startPoint=pointAtParameter_2, direction=tangentAtUParameter, length=code_block_12)
byStartPointDirectionLength_3 = Line.ByStartPointDirectionLength(startPoint=pointAtParameter_2, direction=tangentAtVParameter, length=code_block_12)
